vi "scan_to_position.gvi"   [LabVIEW Conversion 5.3.1.49938]
panel controls:
  "Direction to Move": string
  "Pixel Size (mm)": string
  "Reset (False)": bool  # Specify whether you want the instrument driver to reset the instrument during the initialization procedure.
  "ID Query (True)": bool = TRUE  # Specify whether you want the instrument driver to perform an ID Query.
  "error in (no error)": error
  "VISA resource name": "Instr"
    # Specifies which instrument to use.  Instruments that are powered on and connected to your computer are visible in the VISA resource name pull-down menu.  Select the resource name from the VISA resource name pull-down menu.  If your instrument does not appear in this list, enter the instrument descriptor using the following format:
    # Interface Type[board index]::Address::INSTR.
    # Examples:
    # GPIB:  GPIB::22::INSTR,  GPIB board 0, primary address 22
    # Serial:  COM1
    # TCP/IP Instr:  TCPIP::10.0.32.48::INSTR
    # TCP/IP Socket: TCPIP::10.0.32.45::3800::SOCKET
    # USB Instr:  Selectable from VISA Resource Name pull-down menu
    # USB Raw:  You must first link VISA to non-USBTMC instruments by using the VISA Driver Development Wizard
    # VISA Alias:  "SampleInstr" - Alias names are configured in MAX
    # Refer to the LabVIEW Help for more information about specifying a VISA resource name.
  "Serial Link (RS232)": enum{"RS232", "USB"} = "RS232"
  "error in (no error) 2": error
  "Bytes to read (100)": u32 = 100
  "Wait before read (0ms)": u32
  "error in (no error) 3": error
panel indicators:
  "Command": string
  "error out": error
  "error out 2": error
  "Returned string": string
  "error out 3": error
uses:
  Newport ESP301::Initialize.gvi
  Main::Alex_write_command_and_read.gvi
  Newport ESP301::Close.gvi
diagram:
  call "Initialize.gvi"(VISA resource name=$"VISA resource name", ID Query (True)=$"ID Query (True)", Reset (False)=$"Reset (False)", error in (no error)=$"error in (no error)", Serial Link (RS232)=$"Serial Link (RS232)") -> (VISA resource name out=w1, error out=w2)
  $"error out" <- w2
  case ($"Direction to Move") {
    frame "Positive_X", Default {
      Concatenate Strings("1", "PR+", $"Pixel Size (mm)") -> w3
    }
    frame "Negative_X" {
      Concatenate Strings("1", "PR-", $"Pixel Size (mm)") -> w3
    }
    frame "Positive_Y" {
      Concatenate Strings("2", "PR+", $"Pixel Size (mm)") -> w3
    }
    frame "Negative_Y" {
      Concatenate Strings("2", "PR-", $"Pixel Size (mm)") -> w3
    }
  }
  call "Alex_write_command_and_read.gvi"(VISA resource name=w1, Command=w3, Bytes to read (100)=$"Bytes to read (100)", error in (no error)=$"error in (no error) 2", Wait before read (0ms)=$"Wait before read (0ms)") -> (VISA resource name out=w4, Returned string=w5, error out=w6)
  call "Close.gvi"(VISA resource name=w4, error in (no error)=$"error in (no error) 3") -> (error out=w7)
  $"error out 3" <- w7
  $"Returned string" <- w5
  $"error out 2" <- w6
  $Command <- w3
