vi "testing2.gvi"   [LabVIEW Conversion 5.3.1.49938]
inputs:
  "Numeric in": f64
outputs:
  "Numeric out": f64
diagram:
  Multiply($"Numeric in", 1.8) -> w1
  Add(w1, 32) -> w2
  $"Numeric out" <- w2
