vi "Close.gvi"   [LabVIEW Conversion 5.3.1.49938]
# Performs an instrument error query before terminating the software connection to the instrument.
inputs:
  "VISA resource name": "Instr", required
    # A reference to the instrument in use.  The reference to the resource name is created in the Initialize VI.  Therefore, before calling this VI, you need to call the Initialize VI.  To run this VI interactively, select the previously initialized resource name from the pull-down menu.  To run this VI programmatically, wire the VISA resource name out terminal of the Initialize VI to subsequent VISA resource name input terminals.  You chain instrument driver VIs together by wiring the VISA resource name out terminal to subsequent VISA resource name input terminals.
  "error in (no error)": error
outputs:
  "error out": error
uses:
  NI::VISA::Close (Instr).gvi
diagram:
  # Close Session
  call "Close (Instr).gvi"(session in=$"VISA resource name") -> (error out=w1)
  Merge Errors($"error in (no error)", w1) -> (error out=w2)
  $"error out" <- w2
