vi "Error Query.gvi"   [LabVIEW Conversion 5.3.1.49938]
# Queries the instrument for any errors in the instrument's error queue.  It will continue to read errors until all errors have been read from the instrument.  Any errors will be returned in the error out control.
inputs:
  "VISA resource name": "Instr", required
    # A reference to the instrument in use.  The reference to the resource name is created in the Initialize VI.  Therefore, before calling this VI, you need to call the Initialize VI.  To run this VI interactively, select the previously initialized resource name from the pull-down menu.  To run this VI programmatically, wire the VISA resource name out terminal of the Initialize VI to subsequent VISA resource name input terminals.  You chain instrument driver VIs together by wiring the VISA resource name out terminal to subsequent VISA resource name input terminals.
  "error in (no error)": error
outputs:
  "VISA resource name out": "Instr"  # A copy of the reference to the instrument in use. The reference to the resource name is created in the Initialize VI. Wire the VISA resource name out terminal of the Initialize VI to subsequent VISA resource name input terminals. You chain instrument driver VIs together by wiring the VISA resource name out terminal to subsequent VISA resource name input terminals.
  "Error Code": i32[]  # The instrument-specific error code(s) returned by the instrument.
  "Error Message": string  # Message returned by the instrument describing the instrument error(s).
  "error out": error
uses:
  NI::G Core::Error::Clear Error Cluster.gvi
  Newport ESP301::Write Command and Read.gvi
  NI::G Core::Error::Legacy::Error Cluster From Error Code.gvi
diagram:
  Property Node(instance in=$"error in (no error)") -> ("status"=w1, "code"=w2)
  w3 = -1073807339  # Timeout error
  Is Equal(x=w2, y=w3) -> w4
  Logical Or(not w1, w4) -> w5
  case (w5) {
    frame False, Default {
      w6 = $"VISA resource name"
      w7 = $"error in (no error)"
      w8 = ""
      w9 = i32[] []
    }
    frame True {
      call "Clear Error Cluster.gvi"() -> (error out=w10)
      s1 = ""  # shift register
      s2 = 0  # shift register
      s3 = w10  # shift register
      while {
        w11 = "TB?"  # Error Query Command
        call "Write Command and Read.gvi"(VISA resource name=$"VISA resource name", Command=w11, Bytes to read (100)=1024, error in (no error)=s3) -> (VISA resource name out=w6, Returned string=w12, error out=w13)
        Scan From String(formatString="%[^\\r\\n]", inputString=w12, errIn=w13) -> (errOut=w14, out0=w15)
        Scan From String(formatString="%d", inputString=w12, errIn=w14) -> (errOut=w16, out0=w17)
        Is Equal To 0(x=w17) -> w18
        Select(s=w18, t=s2, f=w17) -> w19
        Property Node(instance in=w16) -> ("status"=w20)
        Logical Or(w20, w18) -> w21
        Concatenate Strings(s1, w15, "\r\n") -> w22
        append w17 to w9
        next s1 = w22
        next s2 = w19
        next s3 = w16
        stop if w21
      }
      Is Not Equal To 0(x=s2) -> w23
      case (w23) {
        frame False, Default {
          w24 = s3
        }
        frame True {
          # If code ever non-zero
          # then set error out to
          # be instrument error
          Concatenate Strings("Instrument reports:\n", s1) -> w25
          call "Error Cluster From Error Code.gvi"(error code=-1074000000, error message=w25, show call chain?=TRUE) -> (error out=w24)
        }
      }
      Merge Errors(w24, $"error in (no error)") -> (error out=w7)
      w8 = s1
    }
  }
  $"Error Code" <- w9
  $"VISA resource name out" <- w6
  $"error out" <- w7
  $"Error Message" <- w8
