vi "Initialize.gvi"   [LabVIEW Conversion 5.3.1.49938]
# Establishes communication with the instrument and optionally performs an instrument identification query and/or an instrument reset.  It also places the instrument in a default state needed for other instrument driver operations.  Therefore, call this VI before calling other instrument driver VIs for this instrument.  Generally, you need to call the Initialize VI only once at the beginning of an application.
inputs:
  "VISA resource name": "Instr", required
    # Specifies which instrument to use.  Instruments that are powered on and connected to your computer are visible in the VISA resource name pull-down menu.  Select the resource name from the VISA resource name pull-down menu.  If your instrument does not appear in this list, enter the instrument descriptor using the following format:
    # Interface Type[board index]::Address::INSTR.
    # Examples:
    # GPIB:  GPIB::22::INSTR,  GPIB board 0, primary address 22
    # Serial:  COM1
    # TCP/IP Instr:  TCPIP::10.0.32.48::INSTR
    # TCP/IP Socket: TCPIP::10.0.32.45::3800::SOCKET
    # USB Instr:  Selectable from VISA Resource Name pull-down menu
    # USB Raw:  You must first link VISA to non-USBTMC instruments by using the VISA Driver Development Wizard
    # VISA Alias:  "SampleInstr" - Alias names are configured in MAX
    # Refer to the LabVIEW Help for more information about specifying a VISA resource name.
  "ID Query (True)": bool = TRUE  # Specify whether you want the instrument driver to perform an ID Query.
  "Reset (False)": bool  # Specify whether you want the instrument driver to reset the instrument during the initialization procedure.
  "error in (no error)": error
  "Serial Link (RS232)": enum{"RS232", "USB"} = "RS232"
outputs:
  "VISA resource name out": "Instr"  # A copy of the reference to the instrument in use. The reference to the resource name is created in the Initialize VI. Wire the VISA resource name out terminal of the Initialize VI to subsequent VISA resource name input terminals. You chain instrument driver VIs together by wiring the VISA resource name out terminal to subsequent VISA resource name input terminals.
  "error out": error
types:
  T1 = cluster{"Baud Rate": u32, "Parity": u16, "Data Bits": u16, "Stop Bits": u16, "Flow Control": u16}
uses:
  NI::VISA::Open (Instr).gvi
  NI::VISA::Flush Buffer (Instr).gvi
  NI::VISA::Set Buffer Size (Instr).gvi
  Newport ESP301::Revision Query.gvi
  Newport ESP301::Reset.gvi
  NI::G Core::Error::Legacy::Error Cluster From Error Code.gvi
  Newport ESP301::Error Query.gvi
  Newport ESP301::Close.gvi
diagram:
  case ($"error in (no error)") {
    frame No Error {
      # Open instrument
      call "Open (Instr).gvi"(resource name=$"VISA resource name", error in=$"error in (no error)", access mode=0) -> (session out=w3, error out=w4)
      # EDIT: Some instruments have different methods
      # for doing a device clear via the serial interface.
      # If you notice an instrument error after the VISA CLR,
      # consult your manual about "device clears."
      # If your instrument doesn't accept VISA CLR for the
      # serial interface, move the VISA CLR inside the case
      # structure for the GPIB case exclusively.
      Property Node(instance in=w3, "Timeout"=1000, error in=w4) -> ("Intf Type"=w5, error out=w6, instance out=w7)
      # Set VISA Attributes
      case (w5) {
        frame Default {
          # TCP/IP, and USB Interface
          w8 = w7
          w9 = w6
        }
        frame 1 {
          # GPIB Interface
          w8 = w7
          w9 = w6
        }
        frame 4 {
          # Serial & "USB" Interface
          # EDIT: Change these settings to valid settings for your instrument.
          # You can only set one termchar for both ASRL End In and ASRL End Out (VISA Read and Write termination characters) per VISA session. If Read and Write use different termination characters, wire none to one of the ASRL End property nodes and termchar to the other.
          case ($"Serial Link (RS232)") {
            frame "RS232" {
              w11 = T1 {"Baud Rate"=19200, "Parity"=0, "Data Bits"=8, "Stop Bits"=10, "Flow Control"=2}  # RS232
              w10 = w11
            }
            frame "USB" {
              w12 = T1 {"Baud Rate"=921600, "Parity"=0, "Data Bits"=8, "Stop Bits"=10, "Flow Control"=2}  # USB Serial
              w10 = w12
            }
          }
          Property Node(instance in=w10) -> ("Baud Rate"=w13, "Flow Control"=w14, "Parity"=w15, "Data Bits"=w16, "Stop Bits"=w17)
          Type Cast(type=u8 0, x="\r") -> w18
          Property Node(instance in=w7, "ASRL End In"="TermChar"(2), "ASRL End Out"="TermChar"(2), "ASRL GPIB TCP USB VXI TermChar"=w18, "ASRL Baud"=w13, "ASRL Flow Cntrl"=w14, "ASRL Parity"=w15, "ASRL Data Bits"=w16, "ASRL Stop Bits"=w17, error in=w6) -> (error out=w19, instance out=w20)
          call "Flush Buffer (Instr).gvi"(session in=w20, error in=w19, mode=0xC0) -> (session out=w21, error out=w22)
          call "Set Buffer Size (Instr).gvi"(session in=w21, error in=w22, buffer=0x30, size=4096) -> (session out=w8, error out=w9)
          Wait(time to wait=500)
        }
      }
      # Query Instrument ID
      case ($"ID Query (True)") {
        frame False, Default {
          w23 = w9
          w24 = w8
        }
        frame True {
          call "Revision Query.gvi"(VISA resource name=w8, error in (no error)=w9) -> (VISA resource name out=w24, error out=w23)
        }
      }
      # Reset Instrument/
      # Default Setup
      case ($"Reset (False)") {
        frame False, Default {
          w25 = w23
          w26 = w24
        }
        frame True {
          case ($"Serial Link (RS232)") {
            frame "RS232" {
              call "Reset.gvi"(VISA resource name=w24, error in (no error)=w23) -> (VISA resource name out=w26, error out=w25)
            }
            frame "USB" {
              call "Error Cluster From Error Code.gvi"(error code=-1074003952, error message="Reset function not supported with USB link.", error in=w23, show call chain?=TRUE) -> (error out=w25)
              w26 = w24
            }
          }
        }
      }
      call "Error Query.gvi"(VISA resource name=w26, error in (no error)=w25) -> (VISA resource name out=w27, error out=w28)
      # Close if Error
      case (w28) {
        frame No Error {
          w1 = w27
          w2 = w28
        }
        frame Error {
          call "Close.gvi"(VISA resource name=w27, error in (no error)=w28) -> (error out=w2)
          Wait(time to wait=500)
          w1 = ""
        }
      }
      Wait(time to wait=500)
    }
    frame Error {
      w1 = $"VISA resource name"
      w2 = $"error in (no error)"
    }
  }
  $"VISA resource name out" <- w1
  $"error out" <- w2
