vi "Move Absolute.gvi"   [LabVIEW Conversion 5.3.1.49938]
# This command initiates an absolute motion. When received, the selected axis Axis (1) will move, with the predefined acceleration and velocity, to the absolute position specified by Position (0 units). If the requested axis is member of a group, this command does not initiate the desired motion. Instead, error xx31, " COMMAND NOT ALLOWED DUE TO GROUP ASSIGNMENT" is generated. Refer HL and HC commands to move along a line or an arc.
# If this command is issued when trajectory mode for this axis is not in trapezoidal or s-curve mode, the controller returns error xx32, “INVALID TRAJECTORY MODE FOR MOVING”.
# NOTE: Even though the command is accepted while a motion is in progress, care should be taken not to reverse direction of motion. When this command is received, the controller verifies if it will produce a change of direction.
inputs:
  "VISA resource name": "Instr", required
    # A reference to the instrument in use.  The reference to the resource name is created in the Initialize VI.  Therefore, before calling this VI, you need to call the Initialize VI.  To run this VI interactively, select the previously initialized resource name from the pull-down menu.  To run this VI programmatically, wire the VISA resource name out terminal of the Initialize VI to subsequent VISA resource name input terminals.  You chain instrument driver VIs together by wiring the VISA resource name out terminal to subsequent VISA resource name input terminals.
  "Axis (1)": i32 = 1  # Axis (1) is an integer between 1 and Max Axis.
  "Position (0 units)": f64  # absolute position destination in defined motion units.
  "error in (no error)": error
outputs:
  "VISA resource name out": "Instr"  # A copy of the reference to the instrument in use. The reference to the resource name is created in the Initialize VI. Wire the VISA resource name out terminal of the Initialize VI to subsequent VISA resource name input terminals. You chain instrument driver VIs together by wiring the VISA resource name out terminal to subsequent VISA resource name input terminals.
  "error out": error
uses:
  Newport ESP301::Write Command and Read.gvi
diagram:
  case ($"error in (no error)") {
    frame No Error {
      w3 = "PA"  # Move Absolute
      Number To Decimal String(number=$"Axis (1)") -> (decimal integer string=w4)
      Number To Fractional String(number=$"Position (0 units)", use system decimal point (T)=FALSE) -> (F-format string=w5)
      Concatenate Strings(w4, w3, w5) -> w6
      call "Write Command and Read.gvi"(VISA resource name=$"VISA resource name", Command=w6, Bytes to read (100)=0, error in (no error)=$"error in (no error)") -> (VISA resource name out=w2, error out=w1)
    }
    frame Error {
      w1 = $"error in (no error)"
      w2 = $"VISA resource name"
    }
  }
  $"VISA resource name out" <- w2
  $"error out" <- w1
