vi "Read absolute position.gvi"   [LabVIEW Conversion 5.3.1.49938]
# Reports actual position.
inputs:
  "VISA resource name": "Instr", required
    # A reference to the instrument in use.  The reference to the resource name is created in the Initialize VI.  Therefore, before calling this VI, you need to call the Initialize VI.  To run this VI interactively, select the previously initialized resource name from the pull-down menu.  To run this VI programmatically, wire the VISA resource name out terminal of the Initialize VI to subsequent VISA resource name input terminals.  You chain instrument driver VIs together by wiring the VISA resource name out terminal to subsequent VISA resource name input terminals.
  "Axis (1)": i32 = 1  # Axis number.
  "error in (no error)": error
outputs:
  "VISA resource name out": "Instr"  # A copy of the reference to the instrument in use. The reference to the resource name is created in the Initialize VI. Wire the VISA resource name out terminal of the Initialize VI to subsequent VISA resource name input terminals. You chain instrument driver VIs together by wiring the VISA resource name out terminal to subsequent VISA resource name input terminals.
  "Position (units)": f64
  "error out": error
uses:
  Newport ESP301::Write Command and Read.gvi
diagram:
  case ($"error in (no error)") {
    frame No Error {
      w4 = "TP?"  # Get Position
      Number To Decimal String(number=$"Axis (1)") -> (decimal integer string=w5)
      Concatenate Strings(w5, w4) -> w6
      call "Write Command and Read.gvi"(VISA resource name=$"VISA resource name", Command=w6, Bytes to read (100)=100, error in (no error)=$"error in (no error)", Wait before read (0ms)=0) -> (VISA resource name out=w3, Returned string=w7, error out=w1)
      Floating Point String To Number(string=w7, use system decimal point (T)=FALSE) -> (number=w2)
    }
    frame Error {
      w1 = $"error in (no error)"
      w2 = default
      w3 = default
    }
  }
  $"Position (units)" <- w2
  $"VISA resource name out" <- w3
  $"error out" <- w1
