vi "Revision Query.gvi"   [LabVIEW Conversion 5.3.1.49938]
# This command is used to read the controller type and version.
# NOTE: Important information needed when asking for technical support for the motion control system or when reporting a problem is the controller version. Use this command to determine the controller type and in particular, the firmware version.
# Refer to the Readme file for detailed driver information including modification history.
inputs:
  "VISA resource name": "Instr", required
    # A reference to the instrument in use.  The reference to the resource name is created in the Initialize VI.  Therefore, before calling this VI, you need to call the Initialize VI.  To run this VI interactively, select the previously initialized resource name from the pull-down menu.  To run this VI programmatically, wire the VISA resource name out terminal of the Initialize VI to subsequent VISA resource name input terminals.  You chain instrument driver VIs together by wiring the VISA resource name out terminal to subsequent VISA resource name input terminals.
  "error in (no error)": error
outputs:
  "VISA resource name out": "Instr"  # A copy of the reference to the instrument in use. The reference to the resource name is created in the Initialize VI. Wire the VISA resource name out terminal of the Initialize VI to subsequent VISA resource name input terminals. You chain instrument driver VIs together by wiring the VISA resource name out terminal to subsequent VISA resource name input terminals.
  "Instrument Driver Revision": string  # Returns the instrument driver software revision in the form of a string.
  "Instrument Firmware Revision": string  # Returns the instrument firmware revision numbers in the form of a string. This version and its capabilities are set by the instrument manufacturer.
  "error out": error
uses:
  Newport ESP301::Write Command and Read.gvi
  NI::G Core::Error::Legacy::Error Cluster From Error Code.gvi
diagram:
  case ($"error in (no error)") {
    frame No Error {
      Property Node(error in=$"error in (no error)") -> ("Library"=w5, error out=w6, instance out=w7)
      Is Not A Number Or Path Or Refnum(number=w5) -> w8
      case (w8) {
        frame False, Default {
          Property Node[IsPlaceholderNodeForConversion=True](instance in=w5, error in=w6) -> ("Version"=w10, error out=w11, instance out=w12)
          Close Reference(error in=w11, reference=w12) -> (error out=w13)
          Close Reference(error in=w13, reference=w7) -> (error out=w9)
          Property Node(instance in=w10) -> ("Major"=w14, "Minor"=w15, "Fix"=w16, "Build"=w17)
          Format Into String(formatString="%d.%d", w14, w15) -> w18
          Is Equal To 0(x=w17) -> w19
          Is Equal To 0(x=w16) -> w20
          Logical And(w20, w19) -> w21
          Format Into String(formatString=".%d", w16) -> w22
          Select(s=w21, t="", f=w22) -> w23
          # Retrieve version information from VI library
          Format Into String(formatString=".%d", w17) -> w24
          Select(s=w19, t="", f=w24) -> w25
          Concatenate Strings(w18, w23, w25) -> w3
        }
        frame True {
          w9 = w6
          w3 = "Driver Not in a Project Library"
        }
      }
      w26 = "VE?"  # Revision Query Command
      call "Write Command and Read.gvi"(VISA resource name=$"VISA resource name", Command=w26, error in (no error)=w9) -> (VISA resource name out=w1, Returned string=w27, error out=w28)
      Match Pattern(regular expression="Version", string=w27) -> (after substring=w29)
      Match Pattern(regular expression="\r", string=w29) -> (before substring=w4)
      Match Pattern(regular expression="ESP301", string=w27) -> (offset past match=w30)
      Is Greater Or Equal To 0(x=w30) -> w31
      case (w31) {
        frame False, Default {
          w32 = "The ID Query failed.  This may mean that you selected the wrong instrument or your instrument did not respond.  You may also be using a model that is not officially supported by this driver.  If you are sure that you have selected the correct instrument and it is responding, try disabling the ID Query."
          call "Error Cluster From Error Code.gvi"(error code=-1074003951, error message=w32, error in=w28, show call chain?=TRUE) -> (error out=w2)
        }
        frame True {
          w2 = w28
        }
      }
    }
    frame Error {
      w1 = $"VISA resource name"
      w2 = $"error in (no error)"
      w3 = default
      w4 = default
    }
  }
  $"Instrument Firmware Revision" <- w4
  $"VISA resource name out" <- w1
  $"error out" <- w2
  $"Instrument Driver Revision" <- w3
