vi "Write Command and Read.gvi"   [LabVIEW Conversion 5.3.1.49938]
inputs:
  "VISA resource name": "Instr" = "COM5", required
    # A reference to the instrument in use.  The reference to the resource name is created in the Initialize VI.  Therefore, before calling this VI, you need to call the Initialize VI.  To run this VI interactively, select the previously initialized resource name from the pull-down menu.  To run this VI programmatically, wire the VISA resource name out terminal of the Initialize VI to subsequent VISA resource name input terminals.  You chain instrument driver VIs together by wiring the VISA resource name out terminal to subsequent VISA resource name input terminals.
  "Command": string, required
  "Bytes to read (100)": u32 = 100
  "error in (no error)": error
  "Wait before read (0ms)": u32
outputs:
  "VISA resource name out": "Instr"  # A copy of the reference to the instrument in use. The reference to the resource name is created in the Initialize VI. Wire the VISA resource name out terminal of the Initialize VI to subsequent VISA resource name input terminals. You chain instrument driver VIs together by wiring the VISA resource name out terminal to subsequent VISA resource name input terminals.
  "Returned string": string
  "error out": error
uses:
  NI::VISA::Flush Buffer (Instr).gvi
  NI::VISA::Write (Instr, String).gvi
  NI::VISA::Read (Instr, String).gvi
diagram:
  case ($"error in (no error)") {
    frame No Error {
      Match Pattern(regular expression="\r", string=$Command) -> (before substring=w4)
      Property Node(instance in=$"VISA resource name", error in=$"error in (no error)") -> ("Intf Type"=w5, error out=w6, instance out=w7)
      case (w5) {
        frame 1 {
          w8 = w7
          w9 = w6
        }
        frame 4 {
          call "Flush Buffer (Instr).gvi"(session in=w7, error in=w6) -> (session out=w8, error out=w9)
        }
        frame Default {
          w8 = w7
          w9 = w6
        }
      }
      call "Write (Instr, String).gvi"(session in=w8, error in=w9, write buffer=w4) -> (session out=w10, error out=w11)
      Is Greater Than 0(x=$"Wait before read (0ms)") -> w12
      case (w12) {
        frame False, Default {
          w13 = w11
        }
        frame True {
          Wait(time to wait=$"Wait before read (0ms)")
          w13 = w11
        }
      }
      Is Equal To 0(x=$"Bytes to read (100)") -> w14
      case (w14) {
        frame False, Default {
          call "Read (Instr, String).gvi"(session in=w10, error in=w13, byte count=$"Bytes to read (100)") -> (session out=w2, error out=w1, read buffer=w3)
        }
        frame True {
          w1 = w13
          w2 = w10
          w3 = default
        }
      }
    }
    frame Error {
      w1 = $"error in (no error)"
      w2 = $"VISA resource name"
      w3 = default
    }
  }
  $"Returned string" <- w3
  $"VISA resource name out" <- w2
  $"error out" <- w1
